# Grasshopper definition Pórtico.gh (Grasshopper 1.0.7)

montantes_horizontais = Slider(5, range=0..10)
quant_pórticos = Slider(15, range=0..20)
altura_pilar = Slider(6, range=0..10)
altura_cumeeira = Slider(4, range=0..10)
curve = Curve(<curve referenced from the Rhino model>)
curve_2 = Curve(<curve referenced from the Rhino model>)

# ---- group: Quantidade de pórticos
divide_curve = DivideCurve(Curve=curve_2, Count=quant_pórticos, Kinks=False)  # -> Points, Tangents, Parameters
divide_curve_2 = DivideCurve(Curve=curve, Count=quant_pórticos, Kinks=False)  # -> Points, Tangents, Parameters

# ---- group: Pilares
unit_z = UnitZ(Factor=altura_pilar)
pontos_base_curva_2 = Point(divide_curve.Points)
pontos_base_curva_1 = Point(divide_curve_2.Points)
move = Move(Geometry=pontos_base_curva_1, Motion=unit_z)  # -> Geometry, Transform
move_2 = Move(Geometry=pontos_base_curva_2, Motion=unit_z)  # -> Geometry, Transform
line = Line(StartPoint=pontos_base_curva_1, EndPoint=move.Geometry)
line_2 = Line(StartPoint=pontos_base_curva_2, EndPoint=move_2.Geometry)

# ---- group: Criação de estruturas laterais
divide_curve_3 = DivideCurve(Curve=line, Count=montantes_horizontais, Kinks=False)  # -> simplify(Points), Tangents, Parameters
divide_curve_4 = DivideCurve(Curve=line_2, Count=montantes_horizontais, Kinks=False)  # -> simplify(Points), Tangents, Parameters
flip_matrix = FlipMatrix(Data=divide_curve_4.Points)
flip_matrix_2 = FlipMatrix(Data=divide_curve_3.Points)
interpolate = Interpolate(Vertices=flip_matrix, Degree=3, Periodic=False, KnotStyle=1)  # -> Curve, Length, Domain
interpolate_2 = Interpolate(Vertices=flip_matrix_2, Degree=3, Periodic=False, KnotStyle=1)  # -> Curve, Length, Domain

# ---- group: Criação cobertura
unit_z_2 = UnitZ(Factor=altura_cumeeira)
line_3 = Line(StartPoint=move.Geometry, EndPoint=move_2.Geometry)

# ----
posição_cumeeira = PointOnCurve(line_3, parameter=0.421)

# ---- group: Criação cobertura (continued)
move_3 = Move(Geometry=posição_cumeeira, Motion=unit_z_2)  # -> Geometry, Transform
line_4 = Line(StartPoint=move_2.Geometry, EndPoint=move_3.Geometry)
line_5 = Line(StartPoint=move.Geometry, EndPoint=move_3.Geometry)

# ---- group: Criação de estruturas da cobertura
divide_curve_5 = DivideCurve(Curve=line_5, Count=montantes_horizontais, Kinks=False)  # -> simplify(Points), Tangents, Parameters
divide_curve_6 = DivideCurve(Curve=line_4, Count=montantes_horizontais, Kinks=False)  # -> simplify(Points), Tangents, Parameters
flip_matrix_3 = FlipMatrix(Data=divide_curve_6.Points)
flip_matrix_4 = FlipMatrix(Data=divide_curve_5.Points)
interpolate_3 = Interpolate(Vertices=flip_matrix_3, Degree=3, Periodic=False, KnotStyle=1)  # -> Curve, Length, Domain
interpolate_4 = Interpolate(Vertices=flip_matrix_4, Degree=3, Periodic=False, KnotStyle=1)  # -> Curve, Length, Domain

# ---- group: Criação de tubos
pipe = Pipe(Curve=[line, line_2, line_5, line_4], Radius=Slider(0.15, range=0..1), Caps=0)
pipe_2 = Pipe(
    Curve=[interpolate_2.Curve, interpolate.Curve, interpolate_4.Curve, interpolate_3.Curve],
    Radius=Slider(0.1, range=0..0.1),
    Caps=0)
